# Dynamo graph AGORA_BIM-DYN-Renombrar planos exportados desde revit.dyn "AGORA_BIM-DYN-Renombrar planos y archivos exportados desde revit" (Dynamo 2.1.0.7500)

# note: Desarrollado en Dynamo 2.0.3, Revit 2020

# group: Información de Entrada
# note: Ruta de carpeta donde se encuentran los archivos a renombrar
directory_path = Directory("No hay ningún archivo seleccionado.")
categories = Categories("OST_Sheets")
all_elements_of_category = ElementsOfCategory(Category=categories)
# note: Parametros a extraer de cada plano.
# Editar los nombres, o agregar y eliminar de acuerdo a las politicas de nomenclatura
string = StringInput("Número de plano")
# note: Caracter(es) para seprarar los campos del nombre de archivo
string_2 = StringInput("-")
string_3 = StringInput("Nombre de plano")
# note: Copyrigth(c) 2020, Germán Andrés Rojas Mahecha
# @AGORA BIM
# www.agorabim.com
# note: This program is free software: you can redistribute it and/or modify it under the terms of the GNU General Public License as published by the Free Software Foundation, either version 3 of the License, or (at your option) any later version.
# This program is distributed in the hope that it will be useful, but WITHOUT ANY WARRANTY; without even the implied warranty of MERCHANTABILITY or FITNESS FOR A PARTICULAR PURPOSE.  See the GNU General Public License for more details.
# You should have received a copy of the GNU General Public License along with this program. If not, see <https://www.gnu.org/licenses/>.
string_4 = StringInput("Fecha de emisión del plano")

# group: Extracción de los nombres de los archivos presentes en la carpeta seleccionada
directory_from_path = DirectoryObject(path=directory_path)
getDirectoryContents = FileSystem.GetDirectoryContents(directory=directory_from_path)
fileName = FileSystem.FileName(path=getDirectoryContents.files)

# group: Extracción de parametros requeridos de los planos
getParameterValueByName = Element.GetParameterValueByName(element=all_elements_of_category, parameterName=string)
getParameterValueByName_2 = Element.GetParameterValueByName(element=all_elements_of_category, parameterName=string_3)
getParameterValueByName_3 = Element.GetParameterValueByName(element=all_elements_of_category, parameterName=string_4)

# group: Extracción de parametros de proyecto
# note: *En este ejemplo se usan parametros Built-In del apartado de Información de Proyecto.
# note: Opción para extraer datos de Información de Proyecto con el package Clockwork
boolean = BoolSelector(true)
projectInfo = Custom[Document.ProjectInfo](toggle=boolean)  # Gets the project information.
count = List.Count(list=all_elements_of_category)
ofRepeatedItem = List.OfRepeatedItem(item=projectInfo.Number, amount=count)
# note: Opción para extraer datos de Información de Proyecto con Python
python_script = Python()
# ---------- python_script.python (15 lines) ----------
import clr
clr.AddReference("RevitServices")
import RevitServices
from RevitServices.Persistence import DocumentManager

#Objeto que representa el archivo de Revit donde estamos trabajando
doc = DocumentManager.Instance.CurrentDBDocument

#Objeto que contiene los parametros que vemos en la ventana de Información de Proyecto
projectInfo = doc.ProjectInformation

#Parametro Numero de Proyecto. Para acceder a otra propiedad de este elemento es necesario consultar la documentación de la API.
projNum = projectInfo.Number

OUT = projNum
# ----------------------------------------
watch = Watch(python_script)

# group: Juntamos todos los valores en el orden correcto para formar el nuevo nombre de archivo
join = String.Join(separator=string_2)  # unwired: string0, string1, string2, string3
combine = List.Combine(comb=join, list1=ofRepeatedItem, list2=getParameterValueByName, list3=getParameterValueByName_2, list4=getParameterValueByName_3)

# group: Renombrar Archivos!
python_script_2 = Python(IN[0]=directory_from_path, IN[1]=getParameterValueByName, IN[2]=fileName, IN[3]=combine)
# ---------- python_script_2.python (35 lines) ----------
# Carga las bibliotecas de DesignScript y normas de Python.
import sys
import clr
clr.AddReference('ProtoGeometry')
from Autodesk.DesignScript.Geometry import *

import os #Modulo de Python para interactuar con el sistema operativo

# Las entradas de este nodo se almacenan como lista en las variables IN.
dataEnteringNode = IN

rutaCarpeta = str(IN[0])
identificadores = IN[1]
nombresActuales = IN[2]
nombresNuevos = IN[3]

errores = [] #Lista para guardar posibles errores al renombrar los archivos

#A partir del identificador (número del plano) cruzamos el nombre actual del archivo con el nuevo nombre, y usando los metodos del modulo os, le damos el formato adecuado para renombrar
for id, nombreNuevo in map(None, identificadores, nombresNuevos):
	for nombreActual in nombresActuales:
		if id in nombreActual:
			archivoActual = os.path.join(rutaCarpeta, nombreActual)
			extension = os.path.splitext(archivoActual)[1]
			archivoNuevo = os.path.join(rutaCarpeta, nombreNuevo + extension)		
			try:
				os.rename(archivoActual, archivoNuevo)
			except Exception as e:
				errores.append(e)

# Asigne la salida a la variable OUT.
if errores:
	OUT= errores
else:
	OUT= "Listo!!!"
# ----------------------------------------
